# Grasshopper definition trancado_quasares.gh (Grasshopper 0.9.76)
# plug-ins: MeshEdit Components, Kangaroo Components, Geco Components

n_de_pórticos = Slider(5, range=0..10)
dim_em_y_pavilhão = Slider(5, range=0..10)

largura_dos_pórticos = Slider(3.5, range=0..10)
altura_dos_pórticos = Slider(3.5, range=0..10)
angulo_inicial_dos_pórticos = Slider(160, range=0..360)
angulo_final_dos_pórticos = Slider(200, range=0..360)

n_de_cordas = Slider(15, range=0..100)
largura_das_cordas = Slider(0.007, range=0..0.1)
largura_perfil_dos_pórticos = Slider(0.035, range=0..0.1)

geometry = Geometry([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])

# ---- group: PORTICOS E ROTAÇÕES
unit_y = UnitY(Factor=1)
# Quasares
# 
# https://www.facebook.com/quasaresarq/
# 
# Trançado - urban furniture
# Largo da Batata, São Paulo, Brazil
# 2015
point = Point(Point(0, 0, 0))
construct_domain = ConstructDomain(DomainStart=expr("-x/2", altura_dos_pórticos), DomainEnd=expr("x/2", altura_dos_pórticos))
construct_domain_2 = ConstructDomain(DomainStart=expr("-x/2", largura_dos_pórticos), DomainEnd=expr("x/2", largura_dos_pórticos))
line_sdl = LineSDL(Start=point, Direction=unit_y, Length=dim_em_y_pavilhão)
construct_domain_3 = ConstructDomain(DomainStart=angulo_inicial_dos_pórticos, DomainEnd=angulo_final_dos_pórticos)
perp_frames = PerpFrames(Curve=line_sdl, Count=n_de_pórticos, Align=True)  # -> Frames, Parameters
range = Range(Domain=construct_domain_3, Steps=dim_em_y_pavilhão)
rotate_3d = Rotate3D(Geometry=perp_frames.Frames, Angle=degrees(range), Center=perp_frames.Frames, Axis=line_sdl)  # -> Geometry, Transform
rectangle = Rectangle(Plane=rotate_3d.Geometry, XSize=construct_domain, YSize=construct_domain_2, Radius=0)  # -> Rectangle, Length
boundary_surfaces = BoundarySurfaces(Edges=rectangle.Rectangle)

# ---- group: TRIM PERFIL
number_slider = Slider(9, range=0..10)
xy_plane = XYPlane(Origin="-5,-2,0")
unit_z = UnitZ(Factor=expr("-x/4", altura_dos_pórticos))
plane_surface = PlaneSurface(Plane=xy_plane, XSize=number_slider, YSize=number_slider)
move = Move(Geometry=plane_surface, Motion=unit_z)  # -> Geometry, Transform

# ---- group: ABRE GEOMETRIA DOS PORTICOS E OS CRIA
split_brep = SplitBrep(Brep=boundary_surfaces, Cutter=move.Geometry)
cull_index = CullIndex(List=split_brep, Indices="1", Wrap=True)
deconstruct_brep = DeconstructBrep(Brep=cull_index)  # -> Faces, simplify(Edges), Vertices
curve = Curve(deconstruct_brep.Edges)
list_item = ListItem(List=curve, Index="2", Wrap=True)
cull_index_2 = CullIndex(List=curve, Indices="2", Wrap=True)
list_item_2 = ListItem(List=cull_index_2, Index=Slider(0, range=0..10), Wrap=True)
list_item_3 = ListItem(List=cull_index_2, Index=Slider(2, range=0..10), Wrap=True)
list_item_4 = ListItem(List=cull_index_2, Index=Slider(1, range=0..1), Wrap=True)

# ---- group: BANCO
number_slider_2 = Slider(0.45, range=0..1)
rectangle_2 = Rectangle(Plane=PlaneXY(0, 0, 0), XSize=number_slider_2, YSize=number_slider_2, Radius=0)  # -> Rectangle, Length
box_rectangle = BoxRectangle(Rectangle=rectangle_2.Rectangle, Height=number_slider_2)
deconstruct_brep_2 = DeconstructBrep(Brep=box_rectangle)  # -> Faces, Edges, Vertices
list_item_5 = ListItem(List=deconstruct_brep_2.Edges, Index=Slider(11, range=0..12), Wrap=True)
list_item_6 = ListItem(List=deconstruct_brep_2.Edges, Index=Slider(0, range=0..12), Wrap=True)
divide_curve = DivideCurve(Curve=list_item_5, Count=Slider(5, range=0..10), Kinks=False)  # -> Points, Tangents, Parameters
divide_curve_2 = DivideCurve(Curve=list_item_6, Count=Slider(5, range=0..10), Kinks=False)  # -> Points, Tangents, Parameters
reverse_list = ReverseList(List=divide_curve.Points)
reverse_list_2 = ReverseList(List=divide_curve_2.Points)
list_item_7 = ListItem(List=deconstruct_brep_2.Edges, Index=Slider(10, range=0..12), Wrap=True)
list_item_8 = ListItem(List=deconstruct_brep_2.Edges, Index=Slider(0, range=0..12), Wrap=True)
list_item_9 = ListItem(List=deconstruct_brep_2.Edges, Index=Slider(8, range=0..12), Wrap=True)
list_item_10 = ListItem(List=deconstruct_brep_2.Edges, Index=Slider(9, range=0..12), Wrap=True)
list_item_11 = ListItem(List=deconstruct_brep_2.Edges, Index=Slider(2, range=0..12), Wrap=True)
list_item_12 = ListItem(List=deconstruct_brep_2.Edges, Index=Slider(2, range=0..12), Wrap=True)
line = Line(StartPoint=reverse_list, EndPoint=divide_curve_2.Points)
cull_index_3 = CullIndex(List=line, Indices=Slider(5, range=0..5), Wrap=True)
number_slider_3 = Slider(5, range=0..10)
divide_curve_3 = DivideCurve(Curve=list_item_7, Count=number_slider_3, Kinks=False)  # -> Points, Tangents, Parameters
divide_curve_4 = DivideCurve(Curve=list_item_8, Count=number_slider_3, Kinks=False)  # -> Points, Tangents, Parameters
divide_curve_5 = DivideCurve(Curve=list_item_9, Count=number_slider_3, Kinks=False)  # -> Points, Tangents, Parameters
divide_curve_6 = DivideCurve(Curve=list_item_11, Count=number_slider_3, Kinks=False)  # -> Points, Tangents, Parameters
divide_curve_7 = DivideCurve(Curve=list_item_10, Count=number_slider_3, Kinks=False)  # -> Points, Tangents, Parameters
divide_curve_8 = DivideCurve(Curve=list_item_12, Count=number_slider_3, Kinks=False)  # -> Points, Tangents, Parameters
largura_do_perfil_superior_fino = Slider(0.03, range=0..0.15)
altura_do_perfil_superior_fino = Slider(0.03, range=0..0.15)
reverse_list_3 = ReverseList(List=divide_curve_5.Points)
reverse_list_4 = ReverseList(List=divide_curve_3.Points)
reverse_list_5 = ReverseList(List=divide_curve_4.Points)
reverse_list_6 = ReverseList(List=divide_curve_8.Points)
line_2 = Line(StartPoint=reverse_list_3, EndPoint=divide_curve_6.Points)
line_3 = Line(StartPoint=divide_curve_3.Points, EndPoint=divide_curve_4.Points)
line_4 = Line(StartPoint=divide_curve_7.Points, EndPoint=reverse_list_6)
cull_index_4 = CullIndex(List=line_2, Indices=Slider(0, range=0..1), Wrap=True)
cull_index_5 = CullIndex(List=line_4, Indices=Slider(0, range=0..1), Wrap=True)
cull_index_6 = CullIndex(List=line_3, Indices=Slider(0, range=0..5), Wrap=True)
pipe = Pipe(Curve=[cull_index_4, cull_index_5, cull_index_6, cull_index_3], Radius=Slider(0.005, range=0..0.01), Caps=0)
curve_2 = Curve(deconstruct_brep_2.Edges)
number_slider_4 = Slider(0.015, range=0..0.1)
extend_curve = ExtendCurve(Curve=curve_2, Type=0, Start=number_slider_4, End=number_slider_4)
list_item_13 = ListItem(List=extend_curve, Index=Slider(4, range=0..12), Wrap=True)
list_item_14 = ListItem(List=extend_curve, Index=Slider(6, range=0..12), Wrap=True)
flip_curve = FlipCurve(Curve=list_item_13)  # -> Curve, Flag
ruled_surface = RuledSurface(CurveA=flip_curve.Curve, CurveB=list_item_14)
list_item_15 = ListItem(List=deconstruct_brep_2.Faces, Index=Slider(5, range=0..10), Wrap=True)
square = Square(Plane=list_item_15, Size=Slider(0.028, range=0..0.5), ExtentX=Slider(17, range=0..20), ExtentY=Slider(16, range=0..20))  # -> Cells, flatten(Points)
area = Area(Geometry=square.Cells)  # -> Area, flatten(Centroid)
circle = Circle(Plane=area.Centroid, Radius=Slider(0.005, range=0..0.01))
solid_difference = SolidDifference(BrepsA=list_item_15, BrepsB=circle)
list_item_16 = ListItem(List=solid_difference, Index=Slider(0, range=0..100), Wrap=True)

# ---- group: PERFIS PORTICOS
geometry_2 = Geometry([list_item_2, list_item_4, list_item_3])

# ----
list_item_17 = ListItem(List=geometry_2, Index=Slider(2, range=0..2), Wrap=True)
list_item_18 = ListItem(List=geometry_2, Index=Slider(0, range=0..2), Wrap=True)
point_on_curve = PointOnCurve(list_item_17, parameter=0.196)
point_on_curve_2 = PointOnCurve(list_item_18, parameter=0.795)
end_points = EndPoints(Curve=list_item_17)  # -> Start, End
end_points_2 = EndPoints(Curve=list_item_18)  # -> Start, End
line_5 = Line(StartPoint=point_on_curve_2, EndPoint=end_points_2.Start)
line_6 = Line(StartPoint=point_on_curve, EndPoint=end_points.End)
flip_curve_2 = FlipCurve(Curve=line_5)  # -> Curve, Flag

# ---- group: TRAVAMENTO INF
end_points_3 = EndPoints(Curve=list_item_3)  # -> Start, End
end_points_4 = EndPoints(Curve=list_item_2)  # -> Start, End
point_2 = Point(flatten(end_points_4.End))
point_3 = Point(flatten(end_points_3.Start))
polyline = PolyLine(Vertices=point_2, Closed=False)
polyline_2 = PolyLine(Vertices=point_3, Closed=False)
explode = Explode(Curve=polyline_2, Recursive=True)  # -> Segments, Vertices
explode_2 = Explode(Curve=polyline, Recursive=True)  # -> Segments, Vertices
curve_3 = Curve(explode.Segments)
curve_4 = Curve(explode_2.Segments)

# ---- group: TRAVAMENTO SUP
number_slider_5 = Slider(0.05, range=0..0.1)
subtraction = Subtraction(A="1", B=number_slider_5)
evaluate_length = EvaluateLength(Curve=list_item_4, Length=number_slider_5, Normalized=True)  # -> Point, Tangent, Parameter
evaluate_length_2 = EvaluateLength(Curve=list_item_4, Length=subtraction, Normalized=True)  # -> Point, Tangent, Parameter
polyline_3 = PolyLine(Vertices=flatten(evaluate_length.Point), Closed=False)
polyline_4 = PolyLine(Vertices=flatten(evaluate_length_2.Point), Closed=False)
explode_3 = Explode(Curve=polyline_3, Recursive=True)  # -> Segments, Vertices
explode_4 = Explode(Curve=polyline_4, Recursive=True)  # -> Segments, Vertices
curve_5 = Curve([explode_4.Segments, explode_3.Segments])
curve_6 = Curve(explode_4.Segments)
curve_7 = Curve(explode_3.Segments)

# ----
number_slider_6 = Slider(0, range=0..0.1)
number_slider_7 = Slider(0, range=0..0.1)
number_slider_8 = Slider(0, range=0..0.1)
number_slider_9 = Slider(0, range=0..0.1)
curve_8 = Curve(curve_6)
curve_9 = Curve(curve_4)
curve_10 = Curve(curve_3)
curve_11 = Curve(curve_7)
extend_curve_2 = ExtendCurve(Curve=curve_8, Type=0, Start=expr("-x", number_slider_6), End=expr("-x", number_slider_6))
extend_curve_3 = ExtendCurve(Curve=curve_11, Type=0, Start=expr("-x", number_slider_8), End=expr("-x", number_slider_8))
extend_curve_4 = ExtendCurve(Curve=curve_9, Type=0, Start=expr("-x", number_slider_7), End=expr("-x", number_slider_7))
extend_curve_5 = ExtendCurve(Curve=curve_10, Type=0, Start=expr("-x", number_slider_9), End=expr("-x", number_slider_9))
curve_12 = Curve(extend_curve_2)
curve_13 = Curve(extend_curve_4)
curve_14 = Curve(extend_curve_5)
curve_15 = Curve(extend_curve_3)

curve_16 = Curve([geometry_2, curve_13, curve_14, curve_15, curve_12])
length = Length(Curve=curve_16)  # -> flatten(Length)
mass_addition = MassAddition(Input=length)  # -> Result, PartialResults
metros_de_tubo = Panel(mass_addition.Result)

largura_do_perfil_superior_fino_2 = Slider(0.05, range=0..0.15)
altura_do_perfil_superior_fino_2 = Slider(0.05, range=0..0.15)
largura_do_perfil_barra = Slider(0.06, range=0..0.15)
altura_do_perfil_barra = Slider(0.06, range=0..0.15)

# ---- group: PÓRTICOS
join_curves = JoinCurves(Curves=[list_item_2, list_item_4, list_item_3], Preserve=False)
construct_domain_4 = ConstructDomain(DomainStart=expr("-x/2", altura_do_perfil_barra), DomainEnd=expr("x/2", altura_do_perfil_barra))
construct_domain_5 = ConstructDomain(DomainStart=expr("-x/2", largura_do_perfil_barra), DomainEnd=expr("x/2", largura_do_perfil_barra))
perp_frames_2 = PerpFrames(Curve=join_curves, Count=Slider(1, range=0..1), Align=True)  # -> Frames, Parameters
rectangle_3 = Rectangle(Plane=perp_frames_2.Frames, XSize=construct_domain_4, YSize=construct_domain_5, Radius=0)  # -> Rectangle, Length
cull_index_7 = CullIndex(List=rectangle_3.Rectangle, Indices=Slider(1, range=0..1), Wrap=True)
sweep1 = Sweep1(Rail=join_curves, Sections=cull_index_7, Miter=1)
bounding_box = BoundingBox(Content=sweep1, Plane=PlaneXY(0, 0, 0))  # -> Box, Box_2

# ---- group: TRAVAMENTO INF
M = Slider(0.05, range=0..0.1)
curve_17 = Curve([curve_4, curve_3])
unit_z_2 = UnitZ(Factor=M)
move_2 = Move(Geometry=curve_17, Motion=unit_z_2)  # -> Geometry, Transform
construct_domain_6 = ConstructDomain(DomainStart=expr("-x/2", largura_do_perfil_superior_fino_2), DomainEnd=expr("x/2", largura_do_perfil_superior_fino_2))
construct_domain_7 = ConstructDomain(DomainStart=expr("-x/2", altura_do_perfil_superior_fino_2), DomainEnd=expr("x/2", altura_do_perfil_superior_fino_2))
perp_frames_3 = PerpFrames(Curve=move_2.Geometry, Count="1", Align=True)  # -> Frames, Parameters
cull_index_8 = CullIndex(List=perp_frames_3.Frames, Indices="1", Wrap=True)
rectangle_4 = Rectangle(Plane=cull_index_8, XSize=construct_domain_7, YSize=construct_domain_6, Radius=0)  # -> Rectangle, Length
sweep1_2 = Sweep1(Rail=graft(move_2.Geometry), Sections=rectangle_4.Rectangle, Miter=1)
cap_holes = CapHoles(Brep=sweep1_2)
solid_difference_2 = SolidDifference(BrepsA=flatten(cap_holes), BrepsB=flatten(bounding_box.Box))

# ---- group: TRAVAMENTO SUP
curve_18 = Curve(curve_5)
perp_frames_4 = PerpFrames(Curve=curve_18, Count="1", Align=True)  # -> Frames, Parameters
pipe_2 = Pipe(Curve=curve_18, Radius=Slider(0.008, range=0..0.1), Caps=0)
unit_z_3 = UnitZ(Factor=1)
cull_index_9 = CullIndex(List=perp_frames_4.Frames, Indices="1", Wrap=True)
align_plane = AlignPlane(Plane=cull_index_9, Direction=unit_z_3)  # -> simplify(Plane), Angle
geometry_3 = Geometry(simplify(pipe_2))
cap_holes_2 = CapHoles(Brep=geometry_3)

# ---- group: CORTE PORT
number = Number(altura_dos_pórticos)
number_slider_10 = Slider(9, range=0..10)
subtraction_2 = Subtraction(A=number, B=Slider(0.12, range=0..1))
xy_plane_2 = XYPlane(Origin="-5,-2,0")
unit_z_4 = UnitZ(Factor=expr("-x/4", subtraction_2))
plane_surface_2 = PlaneSurface(Plane=xy_plane_2, XSize=number_slider_10, YSize=number_slider_10)
move_3 = Move(Geometry=plane_surface_2, Motion=unit_z_4)  # -> Geometry, Transform
split_brep_2 = SplitBrep(Brep=sweep1, Cutter=move_3.Geometry)
cull_index_10 = CullIndex(List=split_brep_2, Indices="1", Wrap=True)
cull_index_11 = CullIndex(List=cull_index_10, Indices="1", Wrap=True)
cap_holes_3 = CapHoles(Brep=cull_index_11)  # -> simplify(Brep)

# ---- group: VETORES
planos_pórticos = Plane(rotate_3d.Geometry)
number_slider_11 = Slider(0, range=0..100)
deconstruct_plane = DeconstructPlane(Plane=planos_pórticos)  # -> Origin, XAxis, YAxis, ZAxis
vector = Vector(graft(deconstruct_plane.YAxis))
vector_xyz = VectorXYZ(XComponent=number_slider_11, YComponent=number_slider_11, ZComponent=number_slider_11)  # -> Vector, Length
reverse = Reverse(Vector=vector)
vector_2 = Vector(graft(deconstruct_plane.XAxis))
vector_3 = Vector(graft(deconstruct_plane.YAxis))

# ---- group: ALMAS
subtraction_3 = Subtraction(A=largura_do_perfil_superior_fino_2, B="0.01")
tam_alma = Slider(0.3, range=0..1)
curve_19 = Curve(move_2.Geometry)
length_2 = Length(Curve=curve_17)
end_points_5 = EndPoints(Curve=curve_19)  # -> Start, End
construct_domain_8 = ConstructDomain(DomainStart=expr("-x/2", subtraction_3), DomainEnd=expr("x/2", subtraction_3))
perp_frames_5 = PerpFrames(Curve=move_2.Geometry, Count="1", Align=True)  # -> Frames, Parameters
vector_2pt = Vector2Pt(PointA=end_points_5.Start, PointB=end_points_5.End, Unitize=False)  # -> Vector, Length
point_on_curve_3 = PointOnCurve(curve_19, parameter=0.5)
subtraction_4 = Subtraction(A=length_2, B=tam_alma)
cull_index_12 = CullIndex(List=perp_frames_5.Frames, Indices="1", Wrap=True)
align_plane_2 = AlignPlane(Plane=point_on_curve_3, Direction=vector_2pt.Vector)  # -> Plane, Angle
division = Division(A=subtraction_4, B=2)
rectangle_5 = Rectangle(Plane=cull_index_12, XSize=construct_domain_8, YSize=construct_domain_8, Radius=0)  # -> Rectangle, Length
center_box = CenterBox(Base=align_plane_2.Plane, X=division, Y=division, Z=".1")
sweep1_3 = Sweep1(Rail=graft(curve_19), Sections=rectangle_5.Rectangle, Miter=1)
cap_holes_4 = CapHoles(Brep=sweep1_3)
solid_difference_3 = SolidDifference(BrepsA=flatten(cap_holes_4), BrepsB=flatten(center_box))
solid_difference_4 = SolidDifference(BrepsA=flatten(solid_difference_3), BrepsB=flatten(bounding_box.Box))
partition_list = PartitionList(List=solid_difference_4, Size=2)  # -> simplify(Chunks)
plane = Plane(align_plane_2.Plane)

# ---- group: BANCO
construct_domain_9 = ConstructDomain(DomainStart=expr("-x/2", largura_do_perfil_superior_fino), DomainEnd=expr("x/2", largura_do_perfil_superior_fino))
construct_domain_10 = ConstructDomain(DomainStart=expr("-x/2", altura_do_perfil_superior_fino), DomainEnd=expr("x/2", altura_do_perfil_superior_fino))
perp_frames_6 = PerpFrames(Curve=extend_curve, Count=Slider(1, range=0..1), Align=True)  # -> Frames, Parameters
rectangle_6 = Rectangle(Plane=perp_frames_6.Frames, XSize=construct_domain_10, YSize=construct_domain_9, Radius=0)  # -> Rectangle, Length
cull_index_13 = CullIndex(List=rectangle_6.Rectangle, Indices=Slider(1, range=0..1), Wrap=True)
sweep1_4 = Sweep1(Rail=graft(extend_curve), Sections=cull_index_13, Miter=1)

# ---- group: FUROS TRAV NOS PORTICOS
solid_difference_5 = SolidDifference(BrepsA=flatten(cap_holes_2), BrepsB=flatten(bounding_box.Box))
deconstruct_brep_3 = DeconstructBrep(Brep=solid_difference_5)  # -> Faces, Edges, Vertices
cull_index_14 = CullIndex(List=deconstruct_brep_3.Edges, Indices="1", Wrap=True)  # -> simplify(flatten(List))
curve_20 = Curve(list_item_4)
area_2 = Area(Geometry=cull_index_14)  # -> Area, Centroid
point_on_curve_4 = PointOnCurve(curve_20, parameter=0.5)
distance = Distance(PointA=point_on_curve_4, PointB=area_2.Centroid)
smaller_than = SmallerThan(FirstNumber=distance, SecondNumber=Slider(1.6, range=0..10))  # -> SmallerThan, OrEqualTo
cull_pattern = CullPattern(List=cull_index_14, CullPattern=smaller_than.SmallerThan)  # -> simplify(List)
group = Group(Objects=[cap_holes_3, cull_pattern])

# ---- group: VISUALIZAR
geometry_4 = Geometry([solid_difference_2, cap_holes_2, cap_holes_3])

# ---- group: DESMONTE TRAV INF
geometry_5 = Geometry(graft(solid_difference_2))
plane_2 = Plane(plane)
list_length = ListLength(List=flatten(geometry_5))
square_2 = Square(Plane="0,-2,0", Size=Slider(2, range=0..10), ExtentX=list_length, ExtentY=Slider(1, range=0..1))  # -> Cells, Points
area_3 = Area(Geometry=square_2.Cells)  # -> Area, Centroid
xy_plane_3 = XYPlane(Origin=area_3.Centroid)
point_4 = Point(flatten(plane_2))
point_5 = Point(flatten(area_3.Centroid))
orient = Orient(Geometry=geometry_5, Source=graft(plane_2), Target=xy_plane_3)  # -> Geometry, Transform
point_list = PointList(Points=point_4, Size=Slider(0.37, range=0..1))
point_list_2 = PointList(Points=point_5, Size=Slider(0.37, range=0..1))

# ---- group: DESMONTE TRAV SUP
plane_3 = Plane(align_plane.Plane)
geometry_6 = Geometry(cap_holes_2)
list_length_2 = ListLength(List=flatten(geometry_6))
square_3 = Square(Plane="0,-4,0", Size=Slider(2, range=0..10), ExtentX=list_length_2, ExtentY=Slider(1, range=0..1))  # -> Cells, Points
area_4 = Area(Geometry=square_3.Cells)  # -> Area, Centroid
point_6 = Point(flatten(plane_3))
yz_plane = YZPlane(Origin=area_4.Centroid)
point_7 = Point(flatten(yz_plane))
orient_2 = Orient(Geometry=geometry_6, Source=plane_3, Target=yz_plane)  # -> Geometry, Transform
point_list_3 = PointList(Points=point_7, Size=Slider(0.37, range=0..1))
point_list_4 = PointList(Points=point_6, Size=Slider(0.37, range=0..1))

# ---- group: LIGAR GUIA
boolean_toggle = BooleanToggle(True)

# ----
# ECOTECT: AQUI O GRASSHOPPER VERIFICA SE O ECOTECT ESTÁ RODANDO
boolean_toggle_2 = BooleanToggle(False)
ecolink = EcoLink(Execute=boolean_toggle_2)
panel = Panel(ecolink)

# ---- group: SOLSTÍCIO VERÃO
number_slider_12 = Slider(22, range=1..31)
number_slider_13 = Slider(12, range=1..12)

# ---- group: EQUINÓCIO OUTONO
number_slider_14 = Slider(20, range=1..31)
number_slider_15 = Slider(3, range=1..12)

# ---- group: EQUINÓCIO PRIMAVERA
number_slider_16 = Slider(9, range=1..12)
number_slider_17 = Slider(22, range=1..31)

# ---- group: SOLSTÍCIO INVERNO
number_slider_18 = Slider(22, range=1..31)
number_slider_19 = Slider(6, range=1..12)

# ---- group: HORÁRIOS DAS SOMBRAS
panel_2 = Panel("6 to 18")
number_slider_20 = Slider(12, range=0..20)

# ---- group: PLANO MESH PARA APARECER SOMBRA
construct_point = ConstructPoint(XCoordinate="-20", YCoordinate="-20", ZCoordinate=0)
construct_point_2 = ConstructPoint(XCoordinate="20", YCoordinate="20", ZCoordinate=0)
rectangle_2pt = Rectangle2Pt(Plane=PlaneXY(0, 0, 0), PointA=construct_point, PointB=construct_point_2, Radius=0)  # -> Rectangle, Length
number_slider_21 = Slider(500, range=0..1000)
mesh_plane = MeshPlane(Boundary=rectangle_2pt.Rectangle, WidthCount=number_slider_21, HeightCount=number_slider_21)  # -> Mesh, Area

# ----
unit_z_5 = UnitZ(Factor=expr("-x", Slider(0.9, range=0..10)))
move_4 = Move(Geometry=mesh_plane.Mesh, Motion=unit_z_5)  # -> Geometry, Transform

# ---- group: VETORES ARGOLAS
no_cordas = Integer(n_de_cordas)
boolean = Slider(0, range=0..1)
boolean_2 = Slider(0, range=0..1)
boolean_3 = Slider(1, range=0..1)
boolean_4 = Slider(1, range=0..1)
multiplication = Multiplication(A=no_cordas, B=2)
multiplication_2 = Multiplication(A=no_cordas, B=2)
addition = Addition(A=no_cordas, B=1)
addition_2 = Addition(A=multiplication, B=1)
addition_3 = Addition(A=multiplication_2, B=2)
series = Series(Start=0, Step=boolean_2, Count=no_cordas)
series_2 = Series(Start=0, Step=boolean, Count=addition_2)
series_3 = Series(Start=boolean_3, Step=0, Count=addition)
series_4 = Series(Start=boolean_4, Step=0, Count=addition_3)
merge = Merge(Data1=series, Data2=series_2, Data3=series_3)
merge_2 = Merge(Data1=series_3, Data2=series_2, Data3=series)
merge_3 = Merge(Data1=series, Data2=series_4, Data3=series)
member_index = MemberIndex(Set=merge_2, Member=boolean)  # -> Index, Count
member_index_2 = MemberIndex(Set=merge_2, Member=boolean_3)  # -> Index, Count
member_index_3 = MemberIndex(Set=merge_3, Member=boolean)  # -> Index, Count
member_index_4 = MemberIndex(Set=merge_3, Member=boolean_3)  # -> Index, Count
member_index_5 = MemberIndex(Set=merge, Member=boolean)  # -> Index, Count
member_index_6 = MemberIndex(Set=merge, Member=boolean_3)  # -> Index, Count
replace_items = ReplaceItems(List=merge_2, Item=vector_xyz.Vector, Indices=member_index.Index, Wrap=False)
replace_items_2 = ReplaceItems(List=merge_3, Item=vector_xyz.Vector, Indices=member_index_3.Index, Wrap=False)
replace_items_3 = ReplaceItems(List=merge, Item=vector_xyz.Vector, Indices=member_index_5.Index, Wrap=False)
replace_items_4 = ReplaceItems(List=replace_items, Item=reverse, Indices=member_index_2.Index, Wrap=False)
replace_items_5 = ReplaceItems(List=replace_items_2, Item=vector_2, Indices=member_index_4.Index, Wrap=False)
replace_items_6 = ReplaceItems(List=replace_items_3, Item=vector_3, Indices=member_index_6.Index, Wrap=False)
addition_4 = Addition(A=replace_items_4, B=replace_items_5)
addition_5 = Addition(A=addition_4, B=replace_items_6)

# ---- group: ARGOLAS
no_cordas_2 = Integer(n_de_cordas)
multiplication_3 = Multiplication(A=no_cordas_2, B=2)
addition_6 = Addition(A=multiplication_3, B=1)
divide_curve_9 = DivideCurve(Curve=list_item_4, Count=addition_6, Kinks=False)  # -> Points, Tangents, Parameters
divide_curve_10 = DivideCurve(Curve=line_6, Count=no_cordas_2, Kinks=False)  # -> Points, Tangents, Parameters
divide_curve_11 = DivideCurve(Curve=flip_curve_2.Curve, Count=no_cordas_2, Kinks=False)  # -> Points, Tangents, Parameters
merge_4 = Merge(Data1=divide_curve_10.Points, Data2=divide_curve_9.Points, Data3=divide_curve_11.Points)
removeduplicatepts = RemoveDuplicatePts(Points=merge_4, Tolerance=0.01)
amplitude = Amplitude(Vector=addition_5, Amplitude=Slider(0.03, range=0..0.1))
move_5 = Move(Geometry=removeduplicatepts, Motion=amplitude)  # -> Geometry, Transform
raio_argola = Slider(0.01914, range=0..0.1)
xz_plane = XZPlane(Origin=move_5.Geometry)
line_7 = Line(StartPoint=removeduplicatepts, EndPoint=move_5.Geometry)
circle_2 = Circle(Plane=xz_plane, Radius=raio_argola)
simplify_tree = SimplifyTree(Tree=[circle_2, line_7], Front=False)
pipe_3 = Pipe(Curve=circle_2, Radius=Slider(0.003, range=0..0.01), Caps=0)
group_2 = Group(Objects=simplify_tree)

# ---- group: TAG PONTOS
point_8 = Point(move_5.Geometry)
list_length_3 = ListLength(List=flatten(point_8))
panel_3 = Panel("""A-
B-
C-
D-
E-
F-""")
list_length_4 = ListLength(List=panel_3)
division_2 = Division(A=list_length_3, B=list_length_4)
series_5 = Series(Start=0, Step=1, Count=division_2)
integer = Integer(series_5)
concatenate = Concatenate(FragmentA=graft(panel_3), FragmentB=integer)
panel_4 = Panel(concatenate)
text_tag_3d = TextTag3D(
    Location=point_8,
    Text=concatenate,
    Size=Slider(0.03, range=0..0.1),
    Colour=ColourSwatch(SwatchColor=RGB(119, 255, 0)),
    Justification=7)

# ---- group: ARGOLAS
point_list_5 = PointList(Points=removeduplicatepts, Size=Slider(0.06, range=0..0.1))

# ---- group: VETORES ARGOLAS (continued)
vector_display = VectorDisplay(Anchor=removeduplicatepts, Vector=addition_5)

# ---- group: PONTOS PARA CORDAS
point_9 = Point(move_5.Geometry)
construct_domain_11 = ConstructDomain(DomainStart=Slider(46, range=0..60), DomainEnd=Slider(61, range=0..61))
construct_domain_12 = ConstructDomain(DomainStart=Slider(0, range=0..60), DomainEnd=Slider(15, range=0..60))
construct_domain_13 = ConstructDomain(DomainStart=Slider(15, range=0..60), DomainEnd=Slider(46, range=0..60))
sub_list = SubList(List=point_9, Domain=construct_domain_11, Wrap=True)  # -> List, Index
sub_list_2 = SubList(List=point_9, Domain=construct_domain_12, Wrap=True)  # -> List, Index
sub_list_3 = SubList(List=point_9, Domain=construct_domain_13, Wrap=True)  # -> List, Index
simplify_tree_2 = SimplifyTree(Tree=sub_list.List, Front=False)
simplify_tree_3 = SimplifyTree(Tree=sub_list_2.List, Front=False)
simplify_tree_4 = SimplifyTree(Tree=sub_list_3.List, Front=False)
split_tree = SplitTree(Data=simplify_tree_2, Masks=flatten("{0}"))  # -> Positive, Negative
split_tree_2 = SplitTree(Data=simplify_tree_2, Masks=flatten("{5}"))  # -> Positive, Negative
split_tree_3 = SplitTree(Data=simplify_tree_3, Masks=flatten("{0}"))  # -> Positive, Negative
split_tree_4 = SplitTree(Data=simplify_tree_4, Masks=flatten("{0}"))  # -> Positive, Negative
split_tree_5 = SplitTree(Data=simplify_tree_3, Masks=flatten("{5}"))  # -> Positive, Negative
split_tree_6 = SplitTree(Data=simplify_tree_4, Masks=flatten("{5}"))  # -> Positive, Negative

# ---- group: DESMONTE PÓRTICOS
bounding_box_2 = BoundingBox(Content=cap_holes_3, Plane=PlaneXY(0, 0, 0))  # -> Box, Box_2
volume = Volume(Geometry=bounding_box_2.Box)  # -> Volume, Centroid
list_length_5 = ListLength(List=flatten(volume.Centroid))
square_4 = Square(Plane=PlaneXY(0, 0, 0), Size=Slider(5, range=0..10), ExtentX=list_length_5, ExtentY=Slider(1, range=0..1))  # -> Cells, Points
xz_plane_2 = XZPlane(Origin=volume.Centroid)
area_5 = Area(Geometry=square_4.Cells)  # -> Area, Centroid
xy_plane_4 = XYPlane(Origin=area_5.Centroid)
orient_3 = Orient(Geometry=group_2, Source=graft(xz_plane_2), Target=xy_plane_4)  # -> Geometry, Transform
orient_4 = Orient(Geometry=group, Source=graft(xz_plane_2), Target=xy_plane_4)  # -> Geometry, Transform

# ---- group: CORDAS CAMADA 2
cull_pattern_2 = CullPattern(List=split_tree_4.Negative, CullPattern=[False, True])
cull_pattern_3 = CullPattern(List=split_tree_6.Negative, CullPattern=[False, True])
data = Data(split_tree_5.Negative)
data_2 = Data(split_tree.Negative)
data_3 = Data(split_tree_3.Negative)
data_4 = Data(split_tree_2.Negative)
shift_list = ShiftList(List=data_3, Shift=expr("-x", "3"), Wrap=True)
shift_list_2 = ShiftList(List=data, Shift=expr("-x", "3"), Wrap=True)
shift_list_3 = ShiftList(List=data_2, Shift="3", Wrap=True)
shift_list_4 = ShiftList(List=data_4, Shift="3", Wrap=True)
data_5 = Data(cull_pattern_2)
data_6 = Data(cull_pattern_3)
line_8 = Line(StartPoint=shift_list, EndPoint=data_6)
line_9 = Line(StartPoint=shift_list_3, EndPoint=data_6)
line_10 = Line(StartPoint=shift_list_2, EndPoint=data_5)
line_11 = Line(StartPoint=shift_list_4, EndPoint=data_5)
panel_5 = Panel("""0
1
2""")
panel_6 = Panel("""13
14
15""")
panel_7 = Panel("""0
1
2""")
panel_8 = Panel("""13
14
15""")
cull_index_15 = CullIndex(List=line_8, Indices=panel_5, Wrap=True)
cull_index_16 = CullIndex(List=line_9, Indices=panel_6, Wrap=True)
cull_index_17 = CullIndex(List=line_10, Indices=panel_7, Wrap=True)
cull_index_18 = CullIndex(List=line_11, Indices=panel_8, Wrap=True)

# ---- group: CORDAS CAMADA 1
cull_pattern_4 = CullPattern(List=split_tree_4.Negative, CullPattern=[True, False])
cull_pattern_5 = CullPattern(List=split_tree_6.Negative, CullPattern=[True, False])
data_7 = Data(split_tree.Negative)
data_8 = Data(split_tree_2.Negative)
data_9 = Data(split_tree_3.Negative)
data_10 = Data(split_tree_5.Negative)
data_11 = Data(cull_pattern_4)
data_12 = Data(cull_pattern_5)
line_12 = Line(StartPoint=data_9, EndPoint=data_12)
line_13 = Line(StartPoint=data_7, EndPoint=data_12)
line_14 = Line(StartPoint=data_10, EndPoint=data_11)
line_15 = Line(StartPoint=data_8, EndPoint=data_11)

# ---- group: ROTATE FACE NORTE PÓRTICOS
unit_y_2 = UnitY(Factor=1)
xy_plane_5 = XYPlane(Origin=Point(0, 0, 0))
geometry_7 = Geometry([orient_4.Geometry, orient_3.Geometry])
line_sdl_2 = LineSDL(Start=xy_plane_5, Direction=unit_y_2, Length=1)
rotate_axis = RotateAxis(Geometry=geometry_7, Angle=degrees(Slider(180, range=0..1000)), Axis=line_sdl_2)  # -> Geometry, Transform

# ----
curve_21 = Curve([line_13, line_12])
curve_22 = Curve([line_14, line_15])
curve_23 = Curve([curve_22, curve_21])

curve_24 = Curve([cull_index_15, cull_index_16])
curve_25 = Curve([cull_index_17, cull_index_18])
curve_26 = Curve([curve_25, curve_24])

curve_27 = Curve([curve_26, curve_23])
removeduplicatelines = RemoveDuplicateLines(Lines=flatten(curve_27), Tolerance=0.01)
unit_y_3 = UnitY(Factor=Slider(0.014, range=0..0.1))
move_6 = Move(Geometry=removeduplicatelines, Motion=unit_y_3)  # -> Geometry, Transform
ruled_surface_2 = RuledSurface(CurveA=move_6.Geometry, CurveB=removeduplicatelines)
pipe_4 = Pipe(Curve=removeduplicatelines, Radius=Slider(0.007, range=0..0.1), Caps=0)

# ---- group: COMPRIMENTO CORDAS
curve_28 = Curve([curve_26, curve_23])
removeduplicatelines_2 = RemoveDuplicateLines(Lines=flatten(curve_28), Tolerance=0.01)
length_3 = Length(Curve=removeduplicatelines_2)  # -> flatten(Length)
mass_addition_2 = MassAddition(Input=length_3)  # -> Result, PartialResults
panel_9 = Panel(mass_addition_2.Result)

# ----
geometry_8 = Geometry(geometry_4)
surface = Surface(ruled_surface_2)

text = Text(flatten(concatenate))
point_10 = Point(flatten(move_5.Geometry))

custom_preview = CustomPreview(Geometry=geometry_8, Shader=ColourSwatch(SwatchColor=RGB(35, 43, 42)))
custom_preview_2 = CustomPreview(Geometry=pipe_3, Shader=ColourSwatch(SwatchColor=RGB(0, 0, 0)))
custom_preview_3 = CustomPreview(Geometry=pipe_4, Shader=ColourSwatch(SwatchColor=RGBA(97, 97, 255, 212)))

geometry_9 = Geometry([surface, geometry_8])

# ---- group: MESH PARA GECO
number_slider_22 = Slider(45, range=0..100)  # disabled
simple_mesh = SimpleMesh(Brep=geometry_9)  # -> flatten(Mesh); disabled
mesh_join = MeshJoin(Meshes=simple_mesh)  # disabled
radians = Radians(Degrees=expr("-45", number_slider_22))  # disabled
xy_plane_6 = XYPlane(Origin=Point(0, 0, 0))  # disabled
rotate = Rotate(Geometry=mesh_join, Angle=radians, Plane=xy_plane_6)  # -> Geometry, Transform; disabled

# ---- group: DESMONTE ALMAS
plane_4 = Plane(simplify(graft(plane)))
geometry_10 = Geometry(partition_list)
list_length_6 = ListLength(List=flatten(plane_4))
square_5 = Square(Plane="0,-2.3,0", Size=Slider(2, range=0..10), ExtentX=list_length_6, ExtentY=Slider(1, range=0..1))  # -> Cells, Points
area_6 = Area(Geometry=square_5.Cells)  # -> Area, Centroid
point_11 = Point(flatten(plane_4))
point_12 = Point(flatten(area_6.Centroid))
point_list_6 = PointList(Points=point_12, Size=Slider(0.37, range=0..1))
point_list_7 = PointList(Points=point_11, Size=Slider(0.37, range=0..1))

# ----
xy_plane_7 = XYPlane(Origin=area_6.Centroid)  # -> simplify(Plane)

# ---- group: DESMONTE ALMAS (continued)
orient_5 = Orient(Geometry=geometry_10, Source=plane_4, Target=xy_plane_7)  # -> Geometry, Transform

# ---- group: LIGAR DESMONTE
cull_pattern_6 = CullPattern(
    List=[orient.Geometry, orient_3.Geometry, orient_4.Geometry, orient_2.Geometry, orient_5.Geometry, rotate_axis.Geometry],
    CullPattern=Toggle(False))
geometry_11 = Geometry(cull_pattern_6)

# ----
cull_pattern_7 = CullPattern(List=[cull_index_16, cull_index_18], CullPattern=boolean_toggle)
series_6 = Series(Start="0", Step="2", Count="3")
series_7 = Series(Start="1", Step="2", Count="3")
curve_29 = Curve(simplify(cull_pattern_7))
integer_2 = Integer(series_6)
integer_3 = Integer(series_7)
concatenate_2 = Concatenate(Fragment_A="{", Fragment_B=integer_2, A="}")
concatenate_3 = Concatenate(Fragment_A="{", Fragment_B=integer_3, A="}")
split_tree_7 = SplitTree(Data=curve_29, Masks=flatten(concatenate_2))  # -> Positive, Negative
split_tree_8 = SplitTree(Data=curve_29, Masks=flatten(concatenate_3))  # -> Positive, Negative
data_13 = Data(flatten(split_tree_7.Positive))
data_14 = Data(flatten(split_tree_8.Positive))
join_curves_2 = JoinCurves(Curves=data_13, Preserve=False)
join_curves_3 = JoinCurves(Curves=data_14, Preserve=False)

cull_pattern_8 = CullPattern(List=[cull_index_15, cull_index_17], CullPattern=boolean_toggle)
series_8 = Series(Start="0", Step="2", Count="3")
series_9 = Series(Start="1", Step="2", Count="3")
curve_30 = Curve(simplify(cull_pattern_8))
integer_4 = Integer(series_8)
integer_5 = Integer(series_9)
concatenate_4 = Concatenate(Fragment_A="{", Fragment_B=integer_4, A="}")
concatenate_5 = Concatenate(Fragment_A="{", Fragment_B=integer_5, A="}")
split_tree_9 = SplitTree(Data=curve_30, Masks=flatten(concatenate_4))  # -> Positive, Negative
split_tree_10 = SplitTree(Data=curve_30, Masks=flatten(concatenate_5))  # -> Positive, Negative
data_15 = Data(flatten(split_tree_9.Positive))
data_16 = Data(flatten(split_tree_10.Positive))
join_curves_4 = JoinCurves(Curves=data_15, Preserve=False)
join_curves_5 = JoinCurves(Curves=data_16, Preserve=False)
join_curves_6 = JoinCurves(Curves=[join_curves_4, join_curves_2], Preserve=False)

join_curves_7 = JoinCurves(Curves=[join_curves_5, join_curves_3], Preserve=False)

# ---- group: SEQUENCIA TRANÇADO
graft_tree = GraftTree(Tree=join_curves_6, IncludeEmptyLists=True, IncludeNullItems=True)  # -> simplify(Tree)
graft_tree_2 = GraftTree(Tree=join_curves_7, IncludeEmptyLists=True, IncludeNullItems=True)  # -> simplify(Tree)
control_points = ControlPoints(Curve=graft_tree)  # -> Points, Weights, Knots
control_points_2 = ControlPoints(Curve=graft_tree_2)  # -> Points, Weights, Knots
key_value_search = KeyValueSearch(Keys=point_10, Values=text, Search=control_points.Points)
key_value_search_2 = KeyValueSearch(Keys=point_10, Values=text, Search=control_points_2.Points)
panel_10 = Panel(key_value_search)
panel_11 = Panel(key_value_search_2)

# ---- group: TAMANHO CORDAS
length_4 = Length(Curve=graft_tree_2)
length_5 = Length(Curve=graft_tree)
tamanho_cordas = Panel(length_4)
tamanho_cordas_2 = Panel(length_5)

# ---- group: EXPORTAR
insert_items = InsertItems(List=key_value_search, Item=length_5, Indices="0", Wrap=True)
insert_items_2 = InsertItems(List=key_value_search_2, Item=length_4, Indices="0", Wrap=True)
panel_12 = Panel(insert_items)
panel_13 = Panel(insert_items_2)

# ----
insert_items_3 = InsertItems(List=insert_items, Item="CAMADA 4", Indices="0", Wrap=True)
insert_items_4 = InsertItems(List=insert_items_2, Item="CAMADA 3", Indices="0", Wrap=True)
panel_14 = Panel(insert_items_4)
panel_15 = Panel(insert_items_3)

cull_pattern_9 = CullPattern(List=[line_13, line_15], CullPattern=boolean_toggle)
series_10 = Series(Start="0", Step="2", Count="3")
series_11 = Series(Start="1", Step="2", Count="3")
curve_31 = Curve(cull_pattern_9)
integer_6 = Integer(series_10)
integer_7 = Integer(series_11)
concatenate_6 = Concatenate(Fragment_A="{", Fragment_B=integer_6, A="}")
concatenate_7 = Concatenate(Fragment_A="{", Fragment_B=integer_7, A="}")
split_tree_11 = SplitTree(Data=curve_31, Masks=flatten(concatenate_6))  # -> Positive, Negative
split_tree_12 = SplitTree(Data=curve_31, Masks=flatten(concatenate_7))  # -> Positive, Negative
data_17 = Data(flatten(split_tree_11.Positive))
data_18 = Data(flatten(split_tree_12.Positive))
join_curves_8 = JoinCurves(Curves=data_17, Preserve=False)
join_curves_9 = JoinCurves(Curves=data_18, Preserve=False)

cull_pattern_10 = CullPattern(List=[line_12, line_14], CullPattern=boolean_toggle)
series_12 = Series(Start="0", Step="2", Count="3")
series_13 = Series(Start="1", Step="2", Count="3")
curve_32 = Curve(cull_pattern_10)
integer_8 = Integer(series_12)
integer_9 = Integer(series_13)
concatenate_8 = Concatenate(Fragment_A="{", Fragment_B=integer_8, A="}")
concatenate_9 = Concatenate(Fragment_A="{", Fragment_B=integer_9, A="}")
split_tree_13 = SplitTree(Data=curve_32, Masks=flatten(concatenate_8))  # -> Positive, Negative
split_tree_14 = SplitTree(Data=curve_32, Masks=flatten(concatenate_9))  # -> Positive, Negative
data_19 = Data(flatten(split_tree_13.Positive))
data_20 = Data(flatten(split_tree_14.Positive))
join_curves_10 = JoinCurves(Curves=data_20, Preserve=False)
join_curves_11 = JoinCurves(Curves=data_19, Preserve=False)
join_curves_12 = JoinCurves(Curves=[join_curves_11, join_curves_8], Preserve=False)

join_curves_13 = JoinCurves(Curves=[join_curves_10, join_curves_9], Preserve=False)

# ---- group: SEQUENCIA TRANÇADO
graft_tree_3 = GraftTree(Tree=join_curves_12, IncludeEmptyLists=True, IncludeNullItems=True)  # -> simplify(Tree)
graft_tree_4 = GraftTree(Tree=join_curves_13, IncludeEmptyLists=True, IncludeNullItems=True)  # -> simplify(Tree)
control_points_3 = ControlPoints(Curve=graft_tree_3)  # -> Points, Weights, Knots
control_points_4 = ControlPoints(Curve=graft_tree_4)  # -> Points, Weights, Knots
key_value_search_3 = KeyValueSearch(Keys=point_10, Values=text, Search=control_points_3.Points)
key_value_search_4 = KeyValueSearch(Keys=point_10, Values=text, Search=control_points_4.Points)
panel_16 = Panel(key_value_search_4)
panel_17 = Panel(key_value_search_3)

# ---- group: TAMANHO CORDAS
length_6 = Length(Curve=graft_tree_4)
length_7 = Length(Curve=graft_tree_3)
tamanho_cordas_3 = Panel(length_6)
tamanho_cordas_4 = Panel(length_7)

# ---- group: EXPORTAR
insert_items_5 = InsertItems(List=key_value_search_3, Item=length_7, Indices="0", Wrap=True)
insert_items_6 = InsertItems(List=key_value_search_4, Item=length_6, Indices="0", Wrap=True)
panel_18 = Panel(insert_items_6)
panel_19 = Panel(insert_items_5)

# ---- group: CORDA SELECIONADA
conjunto_2 = Data(join_curves_12)
conjunto_4 = Data(join_curves_6)
conjunto_3 = Data(join_curves_7)
conjunto_1 = Data(join_curves_13)
seleciona_curva = Slider(2, range=0..15)
data_21 = Data(conjunto_3)
list_item_19 = ListItem(List=data_21, Index=seleciona_curva, Wrap=True)
control_points_5 = ControlPoints(Curve=list_item_19)  # -> Points, Weights, Knots
key_value_search_5 = KeyValueSearch(Keys=point_10, Values=text, Search=control_points_5.Points)
length_8 = Length(Curve=list_item_19)
point_on_curve_5 = PointOnCurve(list_item_19, parameter=0.629)
text_tag_3d_2 = TextTag3D(
    Location=control_points_5.Points,
    Text=key_value_search_5,
    Size=Slider(0.25, range=0..1),
    Colour=ColourSwatch(SwatchColor=RGB(119, 255, 0)),
    Justification=7)
text_tag_3d_3 = TextTag3D(
    Location=point_on_curve_5,
    Text=length_8,
    Size=Slider(0.25, range=0..1),
    Colour=ColourSwatch(SwatchColor=RGB(255, 0, 161)),
    Justification=7)
tamanho_corda = Panel(length_8)
sequencia = Panel(key_value_search_5)

# ---- group: VISUALIZAR
custom_preview_4 = CustomPreview(Geometry=conjunto_2, Shader=ColourSwatch(SwatchColor=RGB(0, 63, 252)))
custom_preview_5 = CustomPreview(Geometry=conjunto_1, Shader=ColourSwatch(SwatchColor=RGB(25, 255, 0)))
custom_preview_6 = CustomPreview(Geometry=conjunto_4, Shader=ColourSwatch(SwatchColor=RGB(252, 0, 0)))
custom_preview_7 = CustomPreview(Geometry=conjunto_3, Shader=ColourSwatch(SwatchColor=RGB(225, 0, 255)))

# ----
insert_items_7 = InsertItems(List=insert_items_5, Item="CAMADA 2", Indices="0", Wrap=True)
insert_items_8 = InsertItems(List=insert_items_6, Item="CAMADA 1", Indices="0", Wrap=True)
panel_20 = Panel(insert_items_8)
panel_21 = Panel(insert_items_7)

merge_5 = Merge(
    Data1=flatten(insert_items_8),
    Data2=flatten(insert_items_7),
    Data3=flatten(insert_items_4),
    Data4=flatten(insert_items_3))
panel_22 = Panel(merge_5)

# ----
# USAR PARA INSOLAÇÃO: LIGAR MESH COM MESH PARA WIREFRAME DO EDIFÍCIO
# CAMINHO DO SOL: USAR ESTA PARTE PARA CAMINHO DO SOL (SUN PATH) E VIZUALIZAÇÃO DE SOMBRAS
boolean_toggle_3 = BooleanToggle(False)
ecoweatherfile = EcoWeatherFile(WEAPath="C:\Users\Henrique\Copy\# QUASARES\BATATALAB\GH\brazil - sao paolo.wea")
number_slider_23 = Slider(0.1, range=0..2)
mesh = Mesh(rotate.Geometry)  # disabled
ecosunpath = EcoSunPath(
    Execute=boolean_toggle_3,
    Day=number_slider_12,
    Month=number_slider_13,
    WeatherDataLocation=ecoweatherfile,
    NorthAngle=Slider(360, range=0..360),
    ScaleFactor=number_slider_23)  # -> RuntimeMessage, Compass, Sunpath, SunriseSunset, SetupDone
range_2 = Range(Domain="13 to 14", Steps=number_slider_20)
ecosunrays = EcoSunRays(Execute=ecosunpath.SetupDone, Day=number_slider_12, Month=number_slider_13, Time=range_2, ScaleFactor=number_slider_23)  # -> RuntimeMessage, SunFocus, SunPosition, SunRay, DiffuseSolar
geometry_12 = Geometry(ecosunpath.Sunpath)
geometry_13 = Geometry(ecosunpath.Compass)
domain = Domain(ecosunpath.SunriseSunset)
mesh_2 = Mesh(mesh)  # disabled
vector_4 = Vector(ecosunrays.SunRay)
number_2 = Number(ecosunrays.DiffuseSolar)
exposure = Exposure(Shape=move_4.Geometry, Obstructions=mesh_2, Rays=vector_4, Energy=number_2, Lambert=False)  # -> Exposure, Range
remap_numbers = RemapNumbers(Value=exposure.Exposure, Source=exposure.Range, Target=Domain(0, 1))
deconstruct_mesh = DeconstructMesh(Mesh=move_4.Geometry)  # -> Vertices, Faces, Colours, Normals

# ---- group: WIREFRAME EDIFÍCIO
tri = Triangulate(Mesh=mesh)  # -> Mesh, Count
medges = MeshEdges(Mesh=tri.Mesh)  # -> NakedEdges, InteriorEdges, NonManifoldEdges
preview = CustomPreview(Geometry=[medges.NakedEdges, medges.InteriorEdges], Shader=ColourSwatch(SwatchColor=RGB(54, 32, 32)))

# ---- group: DISTÂNCIA DO VETOR NO OBJ
multiplication_4 = Multiplication(A=ecosunrays.SunRay, B=Slider(0.3, range=0..1))

# ---- group: INSOLAÇÃO
export_mesh_to_ecotect = EcoMeshExport(
    Execute=Toggle(False),
    MeshObject=tri.Mesh,
    CustomScale=0,
    ModelNew="0",
    FitGrid=True,
    ElementType=7,
    Material=0,
    Zone="Outside")  # -> RuntimeMessage, ExportDone, ObjectID
ecoweatherfile_2 = EcoWeatherFile(WEAPath="C:\Users\Henrique\Copy\# QUASARES\BATATALAB\GH\brazil - sao paolo.wea")
insolation_calculations = EcoSolCal(
    Execute=export_mesh_to_ecotect.ExportDone,
    WeatherDataLocation=ecoweatherfile_2,
    Terrain=2,
    Calculations=0,
    Metrics=0,
    Accumulations="0",
    SkySubdi=Slider(50, range=0..100),
    Switch=False,
    Select3D=False,
    DayPeriod=Domain(1, 365),
    TimePeriod=Domain(8, 18))  # -> RuntimeMessage, CalculationDone
object_request = EcoObjectRequest(Execute=insolation_calculations.CalculationDone, AttributeIndex=1, IntervalIndices=export_mesh_to_ecotect.ObjectID)  # -> RuntimeMessage, RGB, Min, Max, Val
explode_5 = MeshExplode(Mesh=tri.Mesh, Interpolate=False)
mcol = MeshColours(Mesh=graft(explode_5), Colours=graft(object_request.RGB))

# ---- group: TAG INSOLAÇAO
flatten_tree = FlattenTree(Tree=object_request.Val, Path="{0}")
mesh_area = MeshArea(Mesh=explode_5)  # -> Area, Centroid
division_3 = Division(A=flatten_tree, B=Slider(1000, range=0..1000))
integer_10 = Integer(division_3)
text_tag_3d_4 = TextTag3D(Location=mesh_area.Centroid, Text=integer_10, Size=Slider(0.05, range=0..1), Justification=7)

# ---- group: MAPA DE COR DA SOMBRA
colour_hsl = ColourHSL(Alpha="1", Hue="0.6", Saturation="1", Luminance=remap_numbers)

# ----
vector_display_2 = VectorDisplay(Anchor=ecosunrays.SunPosition, Vector=multiplication_4)
construct_mesh = ConstructMesh(Vertices=deconstruct_mesh.Vertices, Faces=deconstruct_mesh.Faces, Colours=colour_hsl)
